# Dynamo graph Export csv couleurs systèmes.dyn "CML_Export csv couleurs systèmes" (Dynamo 3.3.0.6316)

# group: Pour info
# note: Création d'un fichier .csv avec l'abréviation et la couleur pour chaque système (gaines canalisations) afin d'être injecté dans Rainbow BIM

# group: Fichier CSV
directory_path = Directory("C:\Users\mmulliez\OneDrive\Projets python\Rainbow MEP")  # graph input
code_block = CodeBlock { "."; }
nom_fichier = StringInput("Couleur système")  # graph input
code_block_2 = CodeBlock { "csv"; }
join = String.Join(separator=code_block, string0=nom_fichier, string1=code_block_2)
combinePath = FileSystem.CombinePath(string0=directory_path, string1=join)

# group: Récupération systèmes gaines/canalisations
categories = Categories("OST_PipeCurves")
categories_2 = Categories("OST_DuctCurves")
list_create = List.Create(item0=categories, item1=categories_2)
all_elements_of_category = ElementsOfCategory(Category=list_create)
code_block_3 = CodeBlock { "Type de système"; }
getParameterValueByName = Element.GetParameterValueByName(element=all_elements_of_category, parameterName=code_block_3)
flatten = List.Flatten(list=getParameterValueByName)
uniqueItems = List.UniqueItems(list=flatten)

# group: Data CSV
code_block_4 = CodeBlock { "Abréviation"; }
getParameterValueByName_2 = Element.GetParameterValueByName(element=uniqueItems, parameterName=code_block_4)
couleurs_systèmes = Python(IN[0]=uniqueItems)  # CPython3
# ---------- couleurs_systèmes.python (36 lines) ----------
# Charger les bibliothèques DesignScript et Standard Python
import sys
import clr

clr.AddReference("DSCoreNodes")
clr.AddReference("RevitAPI")
clr.AddReference('ProtoGeometry')

from Autodesk.Revit.DB import *
from Autodesk.DesignScript.Geometry import *
from DSCore import Color as DSColor

# Les entrées effectuées dans ce noeud sont stockées sous forme de liste dans les variables IN.
dataEnteringNode = IN
system_types = IN[0]

# Placer votre code au-dessous de cette ligne
result = []

for st in system_types:
    # Récupérer l'objet Revit natif
    try:
        sys_type = st.InternalElement
    except:
        sys_type = st

    # Récupérer la couleur définie dans les remplacements de graphisme
    try:
        color = sys_type.LineColor
        result.append(DSColor.ByARGB(255, color.Red, color.Green, color.Blue))

    except:
        result.append(None)

# Affectez la sortie à la variable OUT.
OUT = result
# ----------------------------------------
red = Color.Red(color=couleurs_systèmes)
green = Color.Green(color=couleurs_systèmes)
blue = Color.Blue(color=couleurs_systèmes)
python_script = Python(IN[0]=uniqueItems)  # CPython3; frozen
# ---------- python_script.python (32 lines) ----------
# Charger les bibliothèques DesignScript et Standard Python
import sys
import clr
clr.AddReference('ProtoGeometry')
from Autodesk.DesignScript.Geometry import *

clr.AddReference("RevitAPI")
from Autodesk.Revit.DB import *

# Les entrées effectuées dans ce noeud sont stockées sous forme de liste dans les variables IN.
dataEnteringNode = IN
system_types = IN[0]

# Placer votre code au-dessous de cette ligne
result = []

for st in system_types:
    # Récupérer l'objet Revit natif
    try:
        sys_type = st.InternalElement
    except:
        sys_type = st

    # Récupérer la couleur définie dans les remplacements de graphisme
    try:
        color = sys_type.LineColor
        result.append((color.Red, color.Green, color.Blue))
    except:
        result.append(None)

# Affectez la sortie à la variable OUT.
OUT = result
# ----------------------------------------

# group: Structure CSV
list_create_2 = List.Create(item0=getParameterValueByName_2, item1=red, item2=green, item3=blue)
transpose = List.Transpose(lists=list_create_2)
code_block_5 = CodeBlock { "Abreviation"; "Red"; "Green"; "Blue"; }
list_create_3 = List.Create(item0=code_block_5.out0, item1=code_block_5.out1, item2=code_block_5.out2, item3=code_block_5.out3)
code_block_6 = CodeBlock { 0; }
insert = List.Insert(list=transpose, element=list_create_3, index=code_block_6)

exportCSV = Data.ExportCSV(filePath=combinePath, data=insert)
